# Dynamo graph Wall Openings Creation_Final.dyn "Wall Openings Creation(w Window)" (Dynamo 2.6.2.15705)
# packages: archi-lab.net 2021.25.2521, spring nodes 210.1.1

code_block = CodeBlock { "Need Package"; "1. Archi-lab"; "2. Universo BIM"; }

# group: Get Walls
categories = Categories("OST_Walls")
all_elements_of_category = ElementsOfCategory(Category=categories)
geometry = Element.Geometry(element=all_elements_of_category)

# group: Select and Get all elements from Linked model
getDocuments = archilab.Revit.Selection.Select.GetDocuments()
n1_linked_model_name_contains_of = StringInput("STR")  # "1. Linked Model Name : Contains of"; graph input
contains = String.Contains(str=getDocuments.Link_Name, searchFor=n1_linked_model_name_contains_of)
code_block_2 = CodeBlock { true; }
firstIndexOf = List.FirstIndexOf(list=contains, item=code_block_2)
getItemAtIndex = List.GetItemAtIndex(list=getDocuments.Link_Doc, index=firstIndexOf)
n2_element_in_linked_model = Categories("OST_StructuralFraming")  # "2. Element in Linked Model"; graph input
get_all_elements_from_linked = Custom[Get All Elements From Linked Model](linkDoc=getItemAtIndex, category=n2_element_in_linked_model)  # package archi-lab.net; This node is based on code posted by Julien Benoit. Big thanks to Julien for sharing his work. This node will retrieve all elements of a given category from a given linked model.
geometry_2 = Element.Geometry(element=get_all_elements_from_linked)

# group: Make Intersected Wall List
flatten = List.Flatten(list=geometry_2)
flatten_2 = List.Flatten(list=geometry)
doesIntersect = Geometry.DoesIntersect(geometry=flatten, other=flatten_2, lacing=CrossProduct)
filterByBoolMask = List.FilterByBoolMask(list=all_elements_of_category, mask=doesIntersect@L2)
watch = Watch(filterByBoolMask.in)
flatten_3 = List.Flatten(list=watch)
code_block_3 = CodeBlock { 1; }
chop = List.Chop(list=flatten_3, lengths=code_block_3)

# group: Get Opening Size and Locations
intersectAll = Geometry.IntersectAll(geometry=geometry_2, others=geometry, lacing=CrossProduct)
clean = List.Clean(list=intersectAll@L1)
boundingBox = Geometry.BoundingBox(geometry=clean)
toCuboid = BoundingBox.ToCuboid(boundingBox=boundingBox)
centroid = Solid.Centroid(solid=toCuboid)
n4_opening_height_tolerance = IntegerSlider(10, range=0..1000 step 1)  # "4. Opening Height Tolerance"; graph input
height = Cuboid.Height(cuboid=toCuboid)
code_block_4 = CodeBlock(b=n4_opening_height_tolerance, a=height) { -b+(-a/2); }
translate = Geometry.Translate(geometry=centroid, zTranslation=code_block_4)
width = Cuboid.Width(cuboid=toCuboid)
n3_opening_width_tolerance = IntegerSlider(10, range=0..1000 step 1)  # "3. Opening Width Tolerance"; graph input

# group: Create Opening Family
family_types = FamilyTypes("Opening:Opening")
ꟿ_familyinstance_byhostandpoint = Custom[ꟿ FamilyInstance.ByHostAndPoint](host=chop, type=family_types, point=translate)  # package spring nodes; Creates hosted family instances(doors/windows) at the specified points. You can feed either a single family type or a unique type for each instance.
code_block_5 = CodeBlock { "Height"; "Tolerance_H"; "Width"; "Tolerance_W"; }
setParameterByName = Element.SetParameterByName(element=ꟿ_familyinstance_byhostandpoint, parameterName=code_block_5.out0, value=height)
setParameterByName_2 = Element.SetParameterByName(element=ꟿ_familyinstance_byhostandpoint, parameterName=code_block_5.out1, value=n4_opening_height_tolerance)
setParameterByName_3 = Element.SetParameterByName(element=ꟿ_familyinstance_byhostandpoint, parameterName=code_block_5.out2, value=width)
setParameterByName_4 = Element.SetParameterByName(element=ꟿ_familyinstance_byhostandpoint, parameterName=code_block_5.out3, value=n3_opening_width_tolerance)
